# Grasshopper definition 3DPrint.gh (Grasshopper 1.0.7)

# ---- group: RH_IN:radius
number_slider = Slider(3, range=0..5)

# ---- group: RH_IN:3dprint
boolean = Boolean(False)

# ---- group: RH_IN:density
number_slider_2 = Slider(8, range=0..50)

# ---- group: RH_INPUT:height
number_slider_3 = Slider(100, range=80..100)

# ---- group: RH_IN:rotate
number_slider_4 = Slider(128, range=0..360)

# ----
construct_domain = ConstructDomain(DomainStart=Slider(0, range=0..1), DomainEnd=Slider(1, range=0..1))

# ---- group: RH_IN:type
value_list = ValueList({"Zero": 0, "One": 1, "Two": 2, "Three": 2² - 1, "Four": Sqrt(16)}, selected="Four")

# ----
integer = Integer()
jagged = SettingsSpeed()

construct_point = ConstructPoint(XCoordinate=0, YCoordinate=0, ZCoordinate=0)
number_slider_5 = Slider(12, range=0..100)
line_sdl = LineSDL(Start=construct_point, Direction=Vector(0, 0, 1), Length=Slider(10, range=1..10))
range = Range(Domain=Domain(0, 1), Steps=number_slider_5)
divide_curve = DivideCurve(Curve=line_sdl, Count=number_slider_5, Kinks=False)  # -> Points, Tangents, Parameters
graph_mapper = GraphMapper(
    range,
    x0=0,
    x1=1,
    y0=0,
    y1=1,
    container_name="Bezier",
    cpx=[0, 0.379699707, 0.75, 1],
    cpy=[0.1616361141, 0.6912076473, 0.75, 0.2995919585])
multiplication = Multiplication(A=graph_mapper, B=Slider(12, range=0..100))
circle_cnr = CircleCNR(Center=divide_curve.Points, Normal=Vector(0, 0, 1), Radius=multiplication)
multiplication_2 = Multiplication(A=graph_mapper, B=Slider(0.6, range=0..1))
seam = Seam(Curve=reparameterize(circle_cnr), Seam=multiplication_2)
number_slider_6 = Slider(12, range=0..100)
divide_curve_2 = DivideCurve(Curve=seam, Count=number_slider_6, Kinks=False)  # -> Points, Tangents, Parameters
series = Series(Start=0, Step=number_slider_6, Count=number_slider_5)
dispatch = Dispatch(List=divide_curve_2.Points, DispatchPattern=[True, False])  # -> ListA, ListB
series_2 = Series(Start=series, Step=1, Count=number_slider_6)
vector_2pt = Vector2Pt(PointA=dispatch.ListB, PointB=graft(divide_curve.Points), Unitize=False)  # -> Vector, Length
shift_list = ShiftList(List=series_2, Shift=1, Wrap=True)
multiplication_3 = Multiplication(A=vector_2pt.Vector, B=Slider(0.2, range=0..1))
addition = Addition(A=shift_list, B=number_slider_6)
addition_2 = Addition(A=series_2, B=number_slider_6)
move = Move(Geometry=dispatch.ListB, Motion=multiplication_3)  # -> Geometry, Transform
series_3 = Series(Start=0, Step=1, Count=number_slider_6)
weave = Weave(Pattern=[0, 1], Stream0=dispatch.ListA, Stream1=move.Geometry, NullGaps=False)
shift_list_2 = ShiftList(List=series_3, Shift=1, Wrap=True)
flatten_tree = FlattenTree(Tree=weave, Path="{0}")
list_length = ListLength(List=flatten_tree)
mesh_quad = MeshQuad(CornerA=shift_list, CornerB=series_2, CornerC=addition, CornerD=addition_2)
mesh_triangle = MeshTriangle(CornerA=series_3, CornerB=list_length, CornerC=shift_list_2)
merge = Merge(Data1=flatten_tree, Data2=construct_point)
merge_2 = Merge(Data1=mesh_quad, Data2=mesh_triangle)
construct_mesh = ConstructMesh(Vertices=merge, Faces=flatten(merge_2))

circle = Circle(Plane=PlaneXY(0, 0, 0), Radius=number_slider)
offset_curve = OffsetCurve(Curve=circle, Distance=Slider(2, range=0..5), Plane=PlaneXY(0, 0, 0), Corners=1)
divide_curve_3 = DivideCurve(Curve=circle, Count=number_slider_2, Kinks=False)  # -> Points, Tangents, Parameters
divide_curve_4 = DivideCurve(Curve=offset_curve, Count=number_slider_2, Kinks=False)  # -> Points, Tangents, Parameters
dispatch_2 = Dispatch(List=divide_curve_3.Points, DispatchPattern=[True, False])  # -> ListA, ListB
dispatch_3 = Dispatch(List=divide_curve_4.Points, DispatchPattern=[True, False])  # -> ListA, ListB
number_slider_7 = Slider(0.1, range=0..0.1)
point = Point(dispatch_2.ListA)
point_2 = Point(dispatch_3.ListA)
weave_2 = Weave(Pattern=[0, 1], Stream0=point, Stream1=point_2, NullGaps=False)
series_4 = Series(Start=0, Step=number_slider_7, Count=number_slider_3)
nurbs_curve = NurbsCurve(Vertices=weave_2, Degree=3, Periodic=True)  # -> Curve, Length, Domain
unit_z = UnitZ(Factor=series_4)
move_2 = Move(Geometry=nurbs_curve.Curve, Motion=unit_z)  # -> Geometry, Transform
construct_domain_2 = ConstructDomain(DomainStart=number_slider_4, DomainEnd=Slider(360, range=0..360))
area = Area(Geometry=move_2.Geometry)  # -> Area, Centroid
range_2 = Range(Domain=construct_domain_2, Steps=number_slider_3)
radians = Radians(Degrees=range_2)
range_3 = Range(Domain=construct_domain, Steps=number_slider_3)
rotate = Rotate(Geometry=move_2.Geometry, Angle=radians, Plane=area.Centroid)  # -> Geometry, Transform
graph_mapper_2 = GraphMapper(range_3, x0=0, x1=1, y0=0, y1=1, container_name="Bezier", cpx=[0, 0.25, 0.75, 1], cpy=[0, 0.25, 0.75, 1])
multiplication_4 = Multiplication(A=graph_mapper_2, B=Slider(1.23, range=0..5))

graph_mapper_3 = GraphMapper(range_3, x0=0, x1=1, y0=0, y1=1, Ox=0.507971704, Oy=0.09610342979, Px=0.75, Py=0.25, container_name="Parabola")
graph_mapper_4 = GraphMapper(
    range_3,
    x0=0,
    x1=1,
    y0=0,
    y1=1,
    container_name="Sinc",
    Equation_X0=0.5,
    Equation_X1=0.6,
    Equation_Y0=0.8,
    Equation_Y1=0.3)
graph_mapper_5 = GraphMapper(
    range_3,
    x0=0,
    x1=1,
    y0=0,
    y1=1,
    Ox=0.5202901959,
    Oy=0.8456518054,
    Px=0.9329710007,
    Py=0.7286226749,
    container_name="Parabola")
graph_mapper_6 = GraphMapper(
    range_3,
    x0=0,
    x1=1,
    y0=0,
    y1=1,
    container_name="Sine Summation",
    Equation0_px=[0.2, 0.3],
    Equation0_py=[0.2, 0.3],
    Equation1_px=[0.6, 0.9],
    Equation1_py=[0.3, 0.5])
stream_filter = StreamFilter(
    Gate=value_list,
    Stream0=graph_mapper_2,
    Stream1=graph_mapper_3,
    Stream2=graph_mapper_4,
    Stream3=graph_mapper_5,
    Stream4=graph_mapper_6)

scale = Scale(Geometry=rotate.Geometry, Center=area.Centroid, Factor=stream_filter)  # -> Geometry, Transform
data_dam = DataDam(DataDataA=scale.Geometry, BufferDelay=10000000, BufferMode=0)
pipe = Pipe(Curve=scale.Geometry, Radius=number_slider_7, Caps=0)
custom_preview = CustomPreview(Geometry=pipe, Material=ColourSwatch(SwatchColor=RGB(145, 141, 141)))

data_dam_2 = DataDam(DataDataA=scale.Geometry, BufferDelay=10000000, BufferMode=0)
mesh_brep = MeshBrep(Brep=pipe, Settings=jagged)
mesh_colours = MeshColours(Mesh=flatten(pipe), Colours=ColourSwatch(SwatchColor=RGB(0, 132, 255)))

loft = Loft(Curves=data_dam_2, Options={Adjust=False, Closed=False, LoftEnds=0, LoftSimp=0, LoftType=0, Rebuild=10, Refit=0.01})
mesh_brep_2 = MeshBrep(
    Brep=loft,
    Settings=flatten({GridMaxCount=0, GridMinCount=16, JaggedSeams=False, MaxEdgeLength=0, MinEdgeLength=0.0001, MinTolerance=0, Refine=True, RefineAngle=0, RelativeTolerance=0.65, SimplePlanes=True, Tolerance=0}))
mesh_edges = MeshEdges(Mesh=mesh_brep_2)  # -> NakedEdges, InteriorEdges, NonManifoldEdges

stream_filter_2 = StreamFilter(Gate=boolean, Stream0=mesh_brep_2, Stream1=mesh_brep)
M = MeshToBase64Draco(mesh=stream_filter_2)  # -> base64Draco; inputs mesh: Mesh
# ---------- M: C# ----------
    var options = new Rhino.FileIO.DracoCompressionOptions();
    options.CompressionLevel = 5;
    options.IncludeTextureCoordinates = false;
    options.IncludeVertexColors = false;

    var compressed = Rhino.FileIO.DracoCompression.Compress(mesh, options);
    base64Draco = compressed.ToBase64String();
# ---------- end M ----------

mesh = Mesh(stream_filter_2)

# ---- group: RH_OUT:meshb64
txt = Text(M)
